# Grasshopper definition hw02-gauge.gh (Grasshopper 1.0.7)

# ----
# Main Rectangle
big_rectangle_height = Slider(2.5, range=0..3)
big_rectangle_width = Slider(1.8, range=0..5)
rectangle = Rectangle(Plane=PlaneXY(0, 0, 0), XSize=big_rectangle_width, YSize=big_rectangle_height, Radius=0)  # -> Rectangle, Length

# ----
# MAIN INPUTS
slot_position_delta = Slider(0.385, range=0..1)
slot_size_delta = Slider(0.033, range=0..1)
caliper_slot = Slider(0.268, range=0..1)
slot_depth = Slider(0.497, range=0..1)

# ----
# The NOTCH in the upper-left
notch_size = Slider(0.3, range=0..1)
subtraction = Subtraction(A=big_rectangle_height, B=notch_size)
rectangle_2 = Rectangle(Plane=PlaneXY(0, 0, 0), XSize=notch_size, YSize=notch_size, Radius=0)  # -> Rectangle, Length
Y = UnitY(Factor=subtraction)
move = Move(Geometry=rectangle_2.Rectangle, Motion=Y)  # -> Geometry, Transform

# ----
# Caliper Slot Postition
# Big Rectangle Width
# Caliper X
# Slot Depth
# Big Rectangle Height
# Caliper Y
# 2
_2 = Number(2)
division = Division(A=big_rectangle_height, B=_2)
subtraction_2 = Subtraction(A=big_rectangle_width, B=slot_depth)

# ----
# One Slot above middle.
# Slot Depth
# Caliper Thickness
# Slot Size Delta
# Caliper Slot X Position
# Slot Postion Delta
# Caliper Slot Y Position
addition = Addition(A=slot_position_delta, B=division)
subtraction_3 = Subtraction(A=caliper_slot, B=slot_size_delta)
rectangle_3 = Rectangle(Plane=PlaneXY(0, 0, 0), XSize=slot_depth, YSize=subtraction_3, Radius=0)  # -> Rectangle, Length
vec = VectorXYZ(XComponent=subtraction_2, YComponent=addition, ZComponent=0)  # -> Vector, Length
move_2 = Move(Geometry=rectangle_3.Rectangle, Motion=vec.Vector)  # -> Geometry, Transform

# ----
# Caliper Slot right edge, in the middle
# Slot Depth
# Caliper Thickness
# Caliper Slot X Position
# Caliper Slot Y Position
rectangle_4 = Rectangle(Plane=PlaneXY(0, 0, 0), XSize=slot_depth, YSize=caliper_slot, Radius=0)  # -> Rectangle, Length
vec_2 = VectorXYZ(XComponent=subtraction_2, YComponent=division, ZComponent=0)  # -> Vector, Length
move_3 = Move(Geometry=rectangle_4.Rectangle, Motion=vec_2.Vector)  # -> Geometry, Transform

# ----
# One slot below middle
# Slot Depth
# Caliper Thickness
# Slot Size Delta
# Caliper Slot X Position
# Caliper Slot X Position
# Caliper Slot Y Position
# Slot Postion Delta
addition_2 = Addition(A=caliper_slot, B=slot_size_delta)
subtraction_4 = Subtraction(A=division, B=slot_position_delta)
vec_3 = VectorXYZ(XComponent=subtraction_2, YComponent=subtraction_4, ZComponent=0)  # -> Vector, Length
rectangle_5 = Rectangle(Plane=PlaneXY(0, 0, 0), XSize=slot_depth, YSize=addition_2, Radius=0)  # -> Rectangle, Length
move_4 = Move(Geometry=rectangle_5.Rectangle, Motion=vec_3.Vector)  # -> Geometry, Transform

# ----
# Second Slot above Middle
# Slot Depth
# Caliper Thickness
# Slot Size Delta
# 2
# Caliper Slot X Position
# Caliper Slot Y Position
# Slot Postion Delta
# 2
_2_2 = Number(2)
multiplication = Multiplication(A=slot_position_delta, B=_2_2)
_2_3 = Number(2)
addition_3 = Addition(A=division, B=multiplication)
multiplication_2 = Multiplication(A=slot_size_delta, B=_2_3)
subtraction_5 = Subtraction(A=caliper_slot, B=multiplication_2)
vec_4 = VectorXYZ(XComponent=subtraction_2, YComponent=addition_3, ZComponent=0)  # -> Vector, Length
rectangle_6 = Rectangle(Plane=PlaneXY(0, 0, 0), XSize=slot_depth, YSize=subtraction_5, Radius=0)  # -> Rectangle, Length
move_5 = Move(Geometry=rectangle_6.Rectangle, Motion=vec_4.Vector)  # -> Geometry, Transform

# ----
# Two Slots below Middle
# Slot Depth
# Caliper Thickness
# Slot Size Delta
# 2
# Caliper Slot X Posiition
# Caliper Slot Y Posiition
# Slot position Delta
# 2
_2_4 = Number(2)
_2_5 = Number(2)
multiplication_3 = Multiplication(A=slot_size_delta, B=_2_5)
multiplication_4 = Multiplication(A=slot_position_delta, B=_2_4)
addition_4 = Addition(A=caliper_slot, B=multiplication_3)
subtraction_6 = Subtraction(A=division, B=multiplication_4)
rectangle_7 = Rectangle(Plane=PlaneXY(0, 0, 0), XSize=slot_depth, YSize=addition_4, Radius=0)  # -> Rectangle, Length
vec_5 = VectorXYZ(XComponent=subtraction_2, YComponent=subtraction_6, ZComponent=0)  # -> Vector, Length
move_6 = Move(Geometry=rectangle_7.Rectangle, Motion=vec_5.Vector)  # -> Geometry, Transform
