# Grasshopper definition hw02-wing-01.gh (Grasshopper 1.0.7)

# ----
# MAIN INPUTS
airfoil_cardboard_thinkness = Slider(0.043, range=0..0.25)
spar_one_height = Slider(0.853, range=0..2)
slot_one_depth = Slider(0.45, range=0..1)
airfoil_count = Slider(0, range=0..20)
wingspan = Slider(17, range=0..48)

spar_cardboard_thickness = Slider(0.243, range=0..1)

# ----
# 2
num = Number(2)
division = Division(A=spar_one_height, B=num)

# ----
# AIRFOIL SLOT
# Cut a slot into the aifroil.  Depth should be the same as the spar slot depth (since we always use one-half spar thickness.
# 
# Width should be from guage tests (i.e. USPS BOX)
# Spar Slot Depth
# Spar Thickness
rectangle = Rectangle(Plane=PlaneXY(0, 0, 0), XSize=spar_cardboard_thickness, YSize=division, Radius=0)  # -> Rectangle, Length

geo = Geometry(<curve referenced from the Rhino model>)

# ----
# SPAR ONE
# Wingspan
# Spar Height
rectangle_2 = Rectangle(Plane=PlaneXY(0, 0, 0), XSize=wingspan, YSize=spar_one_height, Radius=spar_one_height)  # -> Rectangle, Length

# ----
# SPAR ONE SLOT
# Slot Depth
# Airfoil Cardboard Thickness
rectangle_3 = Rectangle(Plane=PlaneXY(0, 0, 0), XSize=airfoil_cardboard_thinkness, YSize=division, Radius=0)  # -> Rectangle, Length

rdiff = RegionDifference(CurvesA=geo, CurvesB=rectangle.Rectangle)

# ----
# END AIRFOIL PLACEMENT
# Left Airfoil
# Spar Slot
# Wingspan
# Right Airfoil
# Offset from spar end
# 2
# 2
wingspan_fraction = Slider(0.019, range=0..0.25)
multiplication = Multiplication(A=wingspan, B=wingspan_fraction)
num_2 = Number(2)
X = UnitX(Factor=multiplication)
multiplication_2 = Multiplication(A=multiplication, B=num_2)
move = Move(Geometry=rectangle_3.Rectangle, Motion=X)  # -> Geometry, Transform
subtraction = Subtraction(A=wingspan, B=multiplication_2)
X_2 = UnitX(Factor=subtraction)
arrlinear = LinearArray(Geometry=move.Geometry, Direction=X_2, Count=num_2)  # -> Geometry, Transform

# ----
# ONE SLOT IN MIDDLE
# Center Airfoil
# Spar Slot
# Take half the spar lengh (i.e. wingspan)
# Spar Length
# 2
# Slot Width
# Subtract half the slot thinkness
num_3 = Number(2)
division_2 = Division(A=wingspan, B=num_3)
division_3 = Division(A=airfoil_cardboard_thinkness, B=num_3)
subtraction_2 = Subtraction(A=division_2, B=division_3)
X_3 = UnitX(Factor=subtraction_2)
move_2 = Move(Geometry=rectangle_3.Rectangle, Motion=X_3)  # -> Geometry, Transform

# ----
# CALCULATE AIRFOIL SPACING
# Wing Span
# Spar Count
relay = Relay()
relay_2 = Relay()
integer_division = IntegerDivision(A=relay, B=relay_2)

# ----
# REPLICATE SPAR SLOTS
# Spar Slot
# Spar Spacing
# Spar Count
relay_3 = Relay()
relay_4 = Relay()
relay_5 = Relay()
X_4 = UnitX(Factor=relay_4)
arrlinear_2 = LinearArray(Geometry=relay_5, Direction=X_4, Count=relay_3)  # -> Geometry, Transform

# ----
# FINAL OUTPUT
merge = Merge(Data2=move_2.Geometry, Data3=move.Geometry, Data4=arrlinear.Geometry)
rdiff_2 = RegionDifference(CurvesA=rectangle_2.Rectangle, CurvesB=merge)
fillet = Slider(0.049, range=0..0.2)
fillet_2 = Fillet(Curve=rdiff_2, Radius=fillet)
