# Grasshopper definition in-class-03-variant.gh (Grasshopper 1.0.7)

big_rectangle_width = Slider(1.8, range=0..5)
big_rectangle_height = Slider(2.5, range=0..3)
notch_size = Slider(0.3, range=0..1)
rectangle = Rectangle(Plane=PlaneXY(0, 0, 0), XSize=Slider(0.3, range=0..10), YSize=Slider(0.3, range=0..1), Radius=0)  # -> Rectangle, Length
rectangle_2 = Rectangle(Plane=PlaneXY(0, 0, 0), XSize=big_rectangle_width, YSize=big_rectangle_height, Radius=0)  # -> Rectangle, Length
num = Number(0)
vec = VectorXYZ(XComponent=num, YComponent=Slider(0.582, range=0..1), ZComponent=0)  # -> Vector, Length
move = Move(Geometry=rectangle.Rectangle, Motion=vec.Vector)  # -> Geometry, Transform
