# Grasshopper definition in-class-03.gh (Grasshopper 1.0.7)

number_slider = Slider(8.44, range=0..10)
number_slider_2 = Slider(0.25, range=0..1)
circle = Circle(Plane=PlaneXY(0, 0, 0), Radius=number_slider)
rectangle = Rectangle(Plane=PlaneXY(0, 0, 0), XSize=number_slider, YSize=Slider(0.71, range=0..1), Radius=0)  # -> Rectangle, Length
subtraction = Subtraction()
number = Number(0.5)
circle_2 = Circle({Plane=Plane(origin=(7.09866825, 10.34084846, 0), x=(0.5710644882, -0.8209052018, 0), y=(0.8209052018, 0.5710644882, 0)), Radius=3.82479678})
multiplication = Multiplication(A=number_slider, B=number)
vector_xyz = VectorXYZ(XComponent=Slider(0.25, range=0..1), YComponent=multiplication, ZComponent=0)  # -> Vector, Length
move = Move(Geometry=rectangle.Rectangle, Motion=vector_xyz.Vector)  # -> Geometry, Transform
polar_array = PolarArray(Geometry=move.Geometry, Plane=PlaneXY(0, 0, 0), Count=Slider(7, range=0..8), Angle=6.283185307)  # -> Geometry, Transform
arrrec = RectangularArray(Cell={Plane=PlaneXY(0, 0, 0), Size=Domain2(u=0..10, v=0..5)}, XCount=6, YCount=3)  # -> Geometry, Transform
