# Grasshopper definition modellab-primer.gh (Grasshopper 1.0.7)

number_slider = Slider(0.139, range=0..1)
# So this is a comment, eh?
circle = CircleCNR(Normal=Vector(0, 0, 1), Radius=1)
pt = Point([Point(3.581024608, 3.374427035, 0), Point(10.05441525, 2.685768456, 0), Point(10.05441525, 9.021427378, 0), Point(3.581024608, 10.1232811, 0)])
addition = Addition()
graph = GraphMapper(x0=0, x1=1, y0=0, y1=1, container_name="Sine", Equation_px=[0.1854466945, 1], Equation_py=[0.1117054224, 1])
crv = Curve()
crv_2 = Curve()
divide = DivideCurve(Curve=[crv, crv_2], Count=10, Kinks=False)  # -> Points, Tangents, Parameters
list = ValueList({"One": 1, "Two": 2, "Three": 2² - 1, "Four": Sqrt(16)}, selected="One")
