# Grasshopper definition ramboll-blog-tutorial..gh (Grasshopper 1.0.7)

pt = Point(Point(-8.514324243, -1.402359287, 0))
pt_2 = Point(Point(4.307246382, 5.409100108, 0))
ln = Line(StartPoint=pt_2, EndPoint=pt)
pipe = Pipe(Curve=ln, Radius=Slider(0.83, range=0..1), Caps=0)
