# Grasshopper definition NACA4seriesaerofoilgeneratorR6.gh (Grasshopper 1.0.7)

high_point_10ths_chord = Slider(8, range=2..8)
points = Slider(101, range=30..200)
camber_chord = Slider(8.5, range=0..9.4)
chord_mm = Slider(208.9, range=1..2000)
thickness_chord = Slider(22.4, range=3..24)
series = Series(Start=0, Step=0.1, Count=11)
division = Division(A=1, B=points)
multiplication = Multiplication(A=thickness_chord, B=0.01)
multiplication_2 = Multiplication(A=camber_chord, B=0.01)
multiplication_3 = Multiplication(A=high_point_10ths_chord, B=0.1)
split = SplitList(List=series, Index=expr("x+1", high_point_10ths_chord))  # -> ListA, ListB
series_2 = Series(Start=0, Step=division, Count=expr("x+1", points))
cos = Cosine(Value=series_2)
item = ListItem(List=reverse(cos), Index=0, Wrap=False)
eval = Evaluate(F="(m/p²)*(2*p*x-x²)", m=multiplication_2, p=multiplication_3, x=split.ListA)
eval_2 = Evaluate(F="(m/(1-p)²)*((1-2*p)+2*p*x-x²)", m=multiplication_2, p=multiplication_3, x=split.ListB)
dom = ConstructDomain(DomainStart=1, DomainEnd=item)
pt = ConstructPoint(XCoordinate=split.ListA, YCoordinate=eval, ZCoordinate=0)
pt_2 = ConstructPoint(XCoordinate=split.ListB, YCoordinate=eval_2, ZCoordinate=0)
remap = RemapNumbers(Value=cos, Source=dom, Target=Domain(0, 1))  # -> Mapped, Clipped
eval_3 = Evaluate(F="(t/.2)*(.2969*Sqrt(x)-.126*x-.3516*x²+.2843*x³-.1015*x^4)", x=remap.Mapped, t=multiplication)
intcrv = Interpolate(Vertices=[pt, pt_2], Degree=3, Periodic=False, KnotStyle=1)  # -> Curve, Length, Domain
multiplication_4 = Multiplication(A=eval_3, B=-1)
fit = FitCurve(Curve=intcrv.Curve, Degree=5)
cull_i = CullIndex(List=remap.Mapped, Indices=0, Wrap=False)
cull_i_2 = CullIndex(List=multiplication_4, Indices=0, Wrap=False)
rev = ReverseList(List=remap.Mapped)
rev_2 = ReverseList(List=eval_3)
int = Integer(camber_chord)
int_2 = Integer(thickness_chord)
pt_3 = ConstructPoint(XCoordinate=flatten([rev, cull_i]), YCoordinate=flatten([rev_2, cull_i_2]), ZCoordinate=0)
int_3 = Integer(high_point_10ths_chord)
end = EndPoints(Curve=fit)  # -> Start, End
concat = Concatenate(FragmentA=int, FragmentB=int_3)
intcrv_2 = Interpolate(Vertices=pt_3, Degree=5, Periodic=False, KnotStyle=1)  # -> Curve, Length, Domain
ln = Line(StartPoint=end.Start, EndPoint=end.End)
concat_2 = Concatenate(FragmentA="0", FragmentB=int_2)
len = TextLength(Text=int_2)  # -> expr("x-1", Length)
flow = Flow(Geometry=intcrv_2.Curve, Base=ln, Target=fit, ReverseBase=False, ReverseTarget=False, Stretch=True, Rigid=False)
fragment = TextFragment(Text=concat_2, Start=len, Count=2)
scale = Scale(Geometry=flow, Center=Point(0, 0, 0), Factor=chord_mm)  # -> Geometry, Transform
concat_3 = Concatenate(FragmentA=concat, FragmentB=fragment)
multiplication_5 = Multiplication(A=multiplication_3, B=chord_mm)
multiplication_6 = Multiplication(A=multiplication_2, B=chord_mm)
end_2 = EndPoints(Curve=scale.Geometry)  # -> Start, End
ln_2 = Line(StartPoint=end_2.Start, EndPoint=end_2.End)
pt_4 = PointXYZ(XComponent=multiplication_5, YComponent=multiplication_6, ZComponent=0)
join = JoinCurves(Curves=[scale.Geometry, ln_2], Preserve=False)
tag = TextTag(Location=pt_4, Text=concat_3)
