# Grasshopper definition hw02-gauge-3dprint.gh (Grasshopper 1.0.7)

# ----
# Main Rectangle
big_rectangle_height = Slider(1.5, range=0..3)
big_rectangle_width = Slider(0.5, range=0..5)
rectangle = Rectangle(Plane=PlaneXY(0, 0, 0), XSize=big_rectangle_width, YSize=big_rectangle_height, Radius=0)  # -> Rectangle, Length

# ----
# MAIN INPUTS
slot_position_delta = Slider(0.248, range=0..1)
slot_size_delta = Slider(0.015, range=0..0.2)
caliper_slot = Slider(0.088, range=0..0.3)
slot_depth = Slider(0.256, range=0..1)

# ----
# The NOTCH in the upper-left
notch_size = Slider(0.138, range=0..1)
subtraction = Subtraction(A=big_rectangle_height, B=notch_size)
rectangle_2 = Rectangle(Plane=PlaneXY(0, 0, 0), XSize=notch_size, YSize=notch_size, Radius=0)  # -> Rectangle, Length
Y = UnitY(Factor=subtraction)
move = Move(Geometry=rectangle_2.Rectangle, Motion=Y)  # -> Geometry, Transform

# ----
# Caliper Slot Postition
# Big Rectangle Width
# Caliper X
# Slot Depth
# Big Rectangle Height
# Caliper Y
# 2
_2 = Number(2)
# Slot Depth
# Caliper Slot Thickness
# Slot position delta
# Slot Size Delta
division = Division(A=big_rectangle_height, B=_2)
subtraction_2 = Subtraction(A=big_rectangle_width, B=slot_depth)

# ----
# One Slot above middle.
# Slot Depth
# Caliper Thickness
# Slot Size Delta
# Caliper Slot X Position
# Slot Postion Delta
# Caliper Slot Y Position
addition = Addition(A=slot_position_delta, B=division)
# Caliper Slot Thickness
# Slot position delta
# Slot Size Delta
subtraction_3 = Subtraction(A=caliper_slot, B=slot_size_delta)
# Slot Depth
rectangle_3 = Rectangle(Plane=PlaneXY(0, 0, 0), XSize=slot_depth, YSize=subtraction_3, Radius=0)  # -> Rectangle, Length
vec = VectorXYZ(XComponent=subtraction_2, YComponent=addition, ZComponent=0)  # -> Vector, Length
move_2 = Move(Geometry=rectangle_3.Rectangle, Motion=vec.Vector)  # -> Geometry, Transform

# ----
# Caliper Slot right edge, in the middle
# Slot Depth
# Caliper Thickness
# Caliper Slot X Position
# Caliper Slot Y Position
rectangle_4 = Rectangle(Plane=PlaneXY(0, 0, 0), XSize=slot_depth, YSize=caliper_slot, Radius=0)  # -> Rectangle, Length
vec_2 = VectorXYZ(XComponent=subtraction_2, YComponent=division, ZComponent=0)  # -> Vector, Length
move_3 = Move(Geometry=rectangle_4.Rectangle, Motion=vec_2.Vector)  # -> Geometry, Transform

# ----
# One slot below middle
# Slot Depth
# Caliper Thickness
# Slot Size Delta
# Caliper Slot X Position
# Caliper Slot Y Position
# Caliper Slot X Position
# Slot Postion Delta
addition_2 = Addition(A=caliper_slot, B=slot_size_delta)
subtraction_4 = Subtraction(A=division, B=slot_position_delta)
vec_3 = VectorXYZ(XComponent=subtraction_2, YComponent=subtraction_4, ZComponent=0)  # -> Vector, Length
# Slot Depth
# Caliper Slot Thickness
# Slot position delta
# Slot Size Delta
rectangle_5 = Rectangle(Plane=PlaneXY(0, 0, 0), XSize=slot_depth, YSize=addition_2, Radius=0)  # -> Rectangle, Length
move_4 = Move(Geometry=rectangle_5.Rectangle, Motion=vec_3.Vector)  # -> Geometry, Transform

# ----
# Two Slots below Middle
# Slot Depth
# Caliper Thickness
# Slot Size Delta
# 2
# Caliper Slot X Posiition
# Caliper Slot Y Posiition
# Slot position Delta
# 2
_2_2 = Number(2)
_2_3 = Number(2)
multiplication = Multiplication(A=slot_position_delta, B=_2_2)
multiplication_2 = Multiplication(A=slot_size_delta, B=_2_3)
subtraction_5 = Subtraction(A=division, B=multiplication)
addition_3 = Addition(A=caliper_slot, B=multiplication_2)
rectangle_6 = Rectangle(Plane=PlaneXY(0, 0, 0), XSize=slot_depth, YSize=addition_3, Radius=0)  # -> Rectangle, Length
vec_4 = VectorXYZ(XComponent=subtraction_2, YComponent=subtraction_5, ZComponent=0)  # -> Vector, Length
move_5 = Move(Geometry=rectangle_6.Rectangle, Motion=vec_4.Vector)  # -> Geometry, Transform

# ----
# Second Slot above Middle
# Slot Depth
# Caliper Thickness
# Slot Size Delta
# 2
# Caliper Slot X Position
# Caliper Slot Y Position
# Slot Postion Delta
# 2
_2_4 = Number(2)
multiplication_3 = Multiplication(A=slot_position_delta, B=_2_4)
_2_5 = Number(2)
addition_4 = Addition(A=division, B=multiplication_3)
multiplication_4 = Multiplication(A=slot_size_delta, B=_2_5)
subtraction_6 = Subtraction(A=caliper_slot, B=multiplication_4)
vec_5 = VectorXYZ(XComponent=subtraction_2, YComponent=addition_4, ZComponent=0)  # -> Vector, Length
rectangle_7 = Rectangle(Plane=PlaneXY(0, 0, 0), XSize=slot_depth, YSize=subtraction_6, Radius=0)  # -> Rectangle, Length
move_6 = Move(Geometry=rectangle_7.Rectangle, Motion=vec_5.Vector)  # -> Geometry, Transform

# ----
# Final Merge, Clip, and Fillet.
# Merge slots and THE NOTCH into one set of things.
# Round out the corners with a fillet.  The slide is more of a "config parameter" than a true input.
merge = Merge(
    Data1=move_5.Geometry,
    Data2=move_3.Geometry,
    Data3=move.Geometry,
    Data4=move_2.Geometry,
    Data5=move_4.Geometry,
    Data6=move_6.Geometry)
# Clip the meged out of the main rectange
rdiff = RegionDifference(CurvesA=rectangle.Rectangle, CurvesB=merge)
fillet = Fillet(Curve=rdiff, Radius=Slider(0.034, range=0..0.05))

# ----
# Duplicate
# Finished Gauge Geometry (clipped & fillted)
# Main Rectangle Width
spacing_between_copies = Slider(1.4, range=1..2)
how_many_copies = Slider(2, range=0..10)
multiplication_5 = Multiplication(A=big_rectangle_width, B=spacing_between_copies)
X = UnitX(Factor=multiplication_5)
arrlinear = LinearArray(Geometry=fillet, Direction=X, Count=how_many_copies)  # -> Geometry, Transform
